test file "minproject1_testfile"
  coverage: Decision, MCDC, Condition

suite "MIL"

  case "Test Case 1" [baseline]
    model model, harness model_Harness1 (for model/controller)
    assessment "Assessment1": At any point of time, if (button1_B==true ) &  (button2_B==false) becomes true then, with a delay of at most 0.5, led1_B must stay true for at least 0.20
    assessment "Assessment2": At any point of time, if button1_B & ~button2_B becomes true then, with no delay, state==1 must be true
    assessment "Assessment3": At any point of time, if button1_B & button2_B becomes true then, with no delay, led1_B & led2_B must be true
    assessment "Assessment4": At any point of time, if ~button1_B & button2_B becomes true then, with no delay, led2_B  &~led1_B must be true
    assessment "Assessment5": At any point of time, if ~button1_B & ~button2_B becomes true then, with no delay, ~led1_B & ~led2_B must be true
      button1_B: signal model_Harness1/Input Conversion Subsystem, port 1
      led1_B: signal model_Harness1/controller, port 1
      button2_B: signal model_Harness1/Input Conversion Subsystem, port 2
      state: signal model_Harness1/Data Type Conversion1, port 1
      led2_B: signal model_Harness1/controller, port 2

suite "Back_to_Back"

  case "model_Harness1" [equivalence]
    simulation 1:
      model model, harness model_Harness2 (for model/controller), mode Normal, start time 0, stop time 10
      signal scenario: test_scenario (model_Harness2/Signal Editor)
      input "Test Case:1" from model_Harness2_sldvdata.mat
      input "Test Case:2" from model_Harness2_sldvdata.mat
      input "Test Case:3" from model_Harness2_sldvdata.mat
      input "Design Verifier (model_Harness2_sldvdata.mat)" from model_Harness2_sldvdata.mat
    simulation 2:
      model model, harness model_SILHarness1 (for model/controller), mode Normal, start time 0, stop time 10
      signal scenario: test_scenario (model_SILHarness1/Signal Editor)
      input "Test Case:1" from model_Harness2_sldvdata.mat
      input "Test Case:2" from model_Harness2_sldvdata.mat
      input "Test Case:3" from model_Harness2_sldvdata.mat
      input "Design Verifier (model_Harness2_sldvdata.mat)" from model_Harness2_sldvdata.mat
    iterations:
      cutom_It: SignalBuilderGroup "test_scenario"